# Dynamo graph MARK CREATOR.dyn (Dynamo 2.16.1.2727)
# packages: Orchid 216.3.0.5889

# group: Category Selection
category_selection = Categories("OST_Conduit")  # graph input

activeView = Orchid.RevitProject.Common.Document.ActiveView()
all_elements_of_category_in_view = ElementsOfCategoryInView(Category=category_selection, View=activeView)

# group: Property Name
# note: OPTIONAL EDITION
p = CodeBlock { "Mark"; }

count = List.Count(list=all_elements_of_category_in_view)
sequence = Sequence(amount=count)
string_from_object = FromObject(object=sequence)
flatten = List.Flatten(list=string_from_object)

# group: Name Mark
prefix_name = StringInput("ALU -  ")  # graph input

concat = String.Concat(string0=prefix_name)  # unwired: string1
map = List.Map(list=flatten, function=concat)
clean = List.Clean(list=map)
setParameterByName = Element.SetParameterByName(element=all_elements_of_category_in_view, parameterName=p, value=clean)  # graph output
